# Grasshopper definition bim_element_extractor.gh (Grasshopper 1.0.7)
# plug-ins: Rhino.Inside for Autodesk Revit, MetaHopper, Human, LunchBox

# ---- group: Get elements by category
# REVIT CATEGORIES
structural_foundation = Data("autodesk.revit.category.family:structuralFoundation-1.0.0")
trusses = Data("autodesk.revit.category.family:truss-1.0.0")
structural_framing = Data("autodesk.revit.category.family:structuralFraming-1.0.0")
structural_columns = Data("autodesk.revit.category.family:structuralColumns-1.0.0")
stairs = Data("autodesk.revit.category.local:stairs-1.0.0")
ramps = Data("autodesk.revit.category.local:ramps-1.0.0")
walls = Data("autodesk.revit.category.local:walls-1.0.0")
windows = Data("autodesk.revit.category.family:windows-1.0.0")
doors = Data("autodesk.revit.category.family:doors-1.0.0")
floors = Data("autodesk.revit.category.local:floors-1.0.0")
roofs = Data("autodesk.revit.category.local:roofs-1.0.0")
stairsrailing = Data("autodesk.revit.category.family:stairsRailing-1.0.0")
rooms = Data("autodesk.revit.category.local:rooms-1.0.0")
furniture = Data("autodesk.revit.category.family:furniture-1.0.0")
built_in_categories = BuiltInCategories("autodesk.revit.category.local:levels-1.0.0", LayoutLevel=2, SearchPattern="<Lev")
merge = Merge(
    Data1=structural_foundation,
    Data2=trusses,
    Data3=structural_framing,
    Data4=structural_columns,
    Data5=stairs,
    Data6=ramps,
    Data7=walls,
    Data8=windows,
    Data9=doors,
    Data10=floors,
    Data11=roofs,
    Data12=stairsrailing,
    Data13=rooms,
    Data14=furniture)
data = Data(built_in_categories)
panel = Panel(data)
category_filter = CategoryFilter(Categories=flatten(merge), Inverted=False)
query_elements = QueryElements(Filter=category_filter, Limit=10000)  # -> Elements, Count

# ---- group: Filter non spatial elements
# FILTER
element_geometry = ElementGeometry(Elements=query_elements.Elements, DetailLevel=1)  # -> simplify(Geometry)
bounding_box = BoundingBox(Content=element_geometry, Plane=PlaneXY(0, 0, 0), UnionBox=True)  # -> Box, Box_2
box_properties = BoxProperties(Box=bounding_box.Box)  # -> Center, Diagonal, Area, flatten(Volume), Degeneracy
cull_pattern = CullPattern(List=query_elements.Elements, CullPattern=box_properties.Volume)

# ----
# LOCATION
# if the Elelment location component is red the filter bypasses it
element_location = ElementLocation(Element=cull_pattern)  # -> Element, simplify(graft(Location)), Hand, Facing, WorkPlane
unit_z = UnitZ(Factor=1)
list_length = ListLength(List=cull_pattern)
duplicate_data = DuplicateData(Data=unit_z, Number=list_length, Order=True)
null_item = NullItem(Item=element_location.Element)  # -> NullFlags, InvalidFlags, Description
boolean = Boolean(invert(null_item.NullFlags))
list_item = ListItem(List=boolean, Index=0, Wrap=True)
stream_filter = StreamFilter(Gate=list_item, Stream0=cull_pattern, Stream1=element_location.Element)
stream_filter_2 = StreamFilter(Gate=list_item, Stream0=duplicate_data, Stream1=element_location.Facing)

# ---- group: Geometry and Bounding Box
# GEOMETRY
element_geometry_2 = ElementGeometry(Elements=stream_filter, DetailLevel=1)  # -> simplify(Geometry)
plane_normal = PlaneNormal(Origin=Point(0, 0, 0), ZAxis=stream_filter_2)  # -> simplify(graft(Plane))
bounding_box_2 = BoundingBox(Content=element_geometry_2, Plane=plane_normal, UnionBox=True)  # -> flatten(Box), Box_2
box_properties_2 = BoxProperties(Box=bounding_box_2.Box)  # -> Center, Diagonal, Area, Volume, Degeneracy
replace_nulls = ReplaceNulls(Items=box_properties_2.Volume, Replacements="0")  # -> Items, Count

# ---- group: solid volume
volume = Volume(Geometry=element_geometry_2)  # -> Volume, Centroid
clean_tree = CleanTree(RemoveNulls=True, RemoveInvalid=True, RemoveEmpty=False, Tree=volume.Volume)
mass_addition = MassAddition(Input=clean_tree)  # -> flatten(Result), PartialResults
replace_nulls_2 = ReplaceNulls(Items=mass_addition.Result, Replacements="0")  # -> Items, Count

# ---- group: Type and Category
element_type = ElementType(Element=cull_pattern)  # -> Element, Type
type_identity = TypeIdentity(Type=element_type.Type)  # -> Category, FamilyName, Name
category_identity = CategoryIdentity(Category=type_identity.Category)  # -> Type, Name, IsSubcategory

# ----
# RHINO LAYERS
create_set = CreateSet(List=category_identity.Name)  # -> Set, Map
list_length_2 = ListLength(List=create_set.Set)  # -> expr("x-1", Length)
range = Range(Domain=list_length_2, Steps=10)
gradient = Gradient(
    LowerLimit=0,
    UpperLimit=list_length_2,
    Parameter=range,
    stops=[0: RGB(243, 57, 0), 0.1: RGB(236, 27, 60), 0.2: RGB(210, 0, 118), 0.3: RGB(103, 0, 120), 0.4: RGB(39, 72, 161), 0.5: RGB(1, 192, 229), 0.6: RGB(18, 178, 90), 0.7: RGB(79, 186, 8), 0.8: RGB(220, 237, 32), 0.9: RGB(247, 159, 20), 1: RGB(243, 57, 0)])
create_modify_layers = CreateModifyLayers(LayerName=create_set.Set, LayerColor=gradient, DeleteLayer=False, enableFullPath=False)  # -> LayerNames, LayerFullPath

# ---- group: HOST ID
element_host = ElementHost(Element=cull_pattern)
element_passport = ElementPassport(Element=element_host)  # -> DocumentGUID, Document, UniqueID, Id

# ---- group: Room name
inspect_element = InspectElement(Element=cull_pattern)

# ----
box_corners = BoxCorners(Box=bounding_box_2.Box)  # -> CornerA, CornerB, CornerC, CornerD, CornerE, CornerF, CornerG, CornerH

# ----
# REVIT ELEMENT DATA
element_passport_2 = ElementPassport(Element=cull_pattern)  # -> DocumentGUID, Document, UniqueID, Id

# ----
# BAKE TO RHINO
createattributes = CreateAttributes(Name=element_passport_2.UniqueID, LayerName=category_identity.Name, enableFullPath=False)
bake_geometry = BakeGeometry(
    Bake=Button(),
    Geometry=element_geometry_2,
    Attributes=graft(createattributes),
    DeleteOldBakes=False,
    PreserveTrees=False)

# ---- group: BB height
distance = Distance(PointA=box_corners.CornerA, PointB=box_corners.CornerE)

# ---- group: BB X dim
distance_2 = Distance(PointA=box_corners.CornerA, PointB=box_corners.CornerB)

# ---- group: BB Y dim
distance_3 = Distance(PointA=box_corners.CornerA, PointB=box_corners.CornerD)

# ----
panel_2 = Panel(category_identity.Name)
null_item_2 = NullItem(Item=distance_2)  # -> NullFlags, InvalidFlags, Description
panel_3 = Panel(distance_2)
mass_addition_2 = MassAddition(Input=null_item_2.NullFlags)  # -> Result, PartialResults

# ---- group: contained in
point_in_brep = PointInBrep(Brep=bounding_box_2.Box, Point=graft(box_properties_2.Center), Strict=True)  # -> simplify(Inside)

# ---- group: contains
point_in_brep_2 = PointInBrep(Brep=graft(bounding_box_2.Box), Point=box_properties_2.Center, Strict=True)  # -> simplify(Inside)

# ----
# RELATIONS
number_slider = Slider(0, range=0..100)
clash = Clash(FirstSet=bounding_box_2.Box, SecondSet=bounding_box_2.Box, Distance=number_slider, ResultLimit=100)  # -> ClashCount, ClashPoints, ClashRadii, FirstIndex, SecondIndex
python_boolean_relation = GhPythonScript(booleans=point_in_brep, ids=element_passport_2.UniqueID)  # -> out, simplify(relation_tree); inputs booleans: tree, ids: list
# ---------- python_boolean_relation: Python ----------
__author__ = "user"
__version__ = "2022.12.13"

import ghpythonlib.treehelpers as th

amount = len(booleans.Branches)
print amount

relation_matrix = []

for i in range(amount):
    branch = booleans.Branch(i)
    if len(branch) != amount:
        out.append("unmatched branch lengths")
    relation_list= []
    for j in range(amount):
        if i!=j:
            if branch[j]:
                relation_list.append(ids[j])
    relation_matrix.append(relation_list)

relation_tree = th.list_to_tree(relation_matrix)
# ---------- end python_boolean_relation ----------
python_boolean_relation_2 = GhPythonScript(booleans=point_in_brep_2, ids=element_passport_2.UniqueID)  # -> out, simplify(relation_tree); inputs booleans: tree, ids: list; same code as python_boolean_relation
python_index_relation = GhPythonScript(first=clash.FirstIndex, second=clash.SecondIndex, ids=element_passport_2.UniqueID)  # -> out, relation_tree; inputs first: list, second: list, ids: list
# ---------- python_index_relation: Python ----------
__author__ = "user"
__version__ = "2022.12.13"

import ghpythonlib.treehelpers as th

assert len(first) == len(second) 
relation_matrix = [ [] for i in range(len(ids))]
for i in range(len(first)):
    f = first[i]
    s = second[i]
    if f!=s:
        relation_matrix[f].append(ids[s])

relation_tree = th.list_to_tree(relation_matrix)
# ---------- end python_index_relation ----------

# ----
# DOC DATA
document_info = DocumentInfo(AutoUpdate=True, Recursive=False)  # -> DocumentName, DocumentFilePath, Components, Params, _3rdPartyAssemblies
document_identity = DocumentIdentity()  # -> DocumentID, ModelPath, Title, IsFamily, UnitSystem
revit_version = RevitVersion()  # -> Name, Version, Build

panel_4 = Panel(document_identity.Title)

# ----
# FILE + PATH
panel_5 = Panel(".json")
file_path = FilePath("C:\code\rhino-inside-revit\")
merge_2 = Merge(Data1=file_path, Data2=document_identity.Title, Data3=panel_5)
merge_3 = Merge(Data1=file_path, Data2=document_identity.Title, Data3=".csv")
text_join = TextJoin(Text=merge_3)
text_join_2 = TextJoin(Text=merge_2)
panel_6 = Panel(text_join_2)

panel_7 = Panel(python_boolean_relation_2.relation_tree)

# ----
# WRITE JSON
boolean_toggle = BooleanToggle(False)
ghpython_script = GhPythonScript(
    write_json=boolean_toggle,
    file_name=text_join_2,
    revit_version=revit_version.Version,
    code_version=document_info.DocumentName,
    doc_id=document_identity.DocumentID,
    doc_name=document_identity.Title,
    unique_ids=element_passport_2.UniqueID,
    ids=element_passport_2.Id,
    category_names=category_identity.Name,
    family_names=type_identity.FamilyName,
    type_names=type_identity.Name,
    host_ids=element_passport.UniqueID,
    BB_X_dims=distance_2,
    BB_Y_dims=distance_3,
    BB_Z_dims=distance,
    BB_volumes=replace_nulls.Items,
    BB_centers=box_properties_2.Center,
    BB_plane_Zs=stream_filter_2,
    solid_volumes=replace_nulls_2.Items,
    room_names=inspect_element,
    relations_intersects=python_index_relation.relation_tree,
    relations_contains=python_boolean_relation_2.relation_tree,
    relations_contained_in=python_boolean_relation.relation_tree)  # -> out, names, types, simplify(all_data_tree), dicts, doc_json; inputs unique_ids: list, ids: list of Int32, category_names: list, family_names: list, type_names: list, host_ids: list, BB_X_dims: list, BB_Y_dims: list, BB_Z_dims: list, BB_volumes: list, BB_centers: list of Point3d, BB_plane_Zs: list of Vector3d, solid_volumes: list, room_names: list, relations_intersects: tree, relations_contains: tree, relations_contained_in: tree
# ---------- ghpython_script: Python ----------
__author__ = "user"
__version__ = "2022.12.15"

import Rhino as rh
import json
import ghpythonlib.treehelpers as th
import GhPython as gh
import datetime

def FormatData(counter): 
    new_dict = dict()
    new_list = []
    


def GHPointToDict( _point) :
    val = _point.Value
    point_dict = {
        'X' : val.X,
        'Y' :val.Y , 
        'Z' :val.Z
        }
    return point_dict

def GetDataType(_data):
    #### default type is always a string
    found_type= "<type 'GH_String'>"
    for d in _data:
        if str(type(d)) !=  "<type 'NoneType'>" :
            found_type= str(type(d))
            break
    print found_type
    return found_type

def ReadListInput(_input):
    tuple_name = _input.Name[:-1]
    data = [item for item in _input.VolatileData]
    if len(data) != ID_LEN :
        raise ValueError ("wrong number of elements: "+tuple_name)
    item_type = GetDataType(data)
    
    for counter in range(len(data)):
        item = data[counter]
        cur_dict = dicts[counter]
        
        if not item: 
            cur_dict.update({tuple_name: 0})
            continue
        
        if item_type == "<type 'GH_String'>" or item_type == "<type 'ParameterValue'>":
            cur_dict.update({tuple_name:str(item)})
        elif item_type == "<type 'GH_Point'>" or item_type == "<type 'GH_Vector'>":
            cur_dict.update({tuple_name: GHPointToDict(item)})
        elif item_type == "<type 'GH_Number'>" or  item_type == "<type 'GH_Integer'>":
            cur_dict.update({tuple_name: item.Value})
        else:
            raise ValueError("unknown type: " + item_type)
    return item_type, data

def ReadTreeInput(_input):
    tuple_name = _input.Name[10:]
    data = [list(item) for item in _input.VolatileData.Branches]
    if len(data) != ID_LEN :
        raise ValueError ("wrong number of elements: "+tuple_name)
    item_type = GetDataType(data)
    
    for counter in range(len(data)):
        branch_data = [ str(d) for d in data[counter] ]
        cur_dict = dicts[counter]
        cur_dict.update({tuple_name:branch_data})

    return item_type, data

def ReadItemInput(_input):
        
        if str(_input.Name) == "write_json":
            time_stamp = datetime.datetime.now()
            #print "the time is: " , time_stamp
            data = [time_stamp]
            doc_dict.update({"time":str(time_stamp)})
        else:
            data = [str(item) for item in _input.VolatileData]
            doc_dict.update({str(_input.Name):data[0]})
            #print "doc dict is: " , str(doc_dict)
        return type(data), data

dicts = [ {'element_index': i} for i in range(len(unique_ids)) ]
names = []
all_data = []
types = []
ID_LEN = len(unique_ids)
doc_dict = dict()


for i,input in enumerate(ghenv.Component.Params.Input):
    print "input param #" , i , " name: " , input.Name
    print str(input.Access)
    names.append(input.Name)
    if str(input.Access) == 'item':
        d_type, data = ReadItemInput(input)
    elif str(input.Access) == 'list':
        d_type, data = ReadListInput(input)
    elif str(input.Access) == 'tree':
        d_type, data = ReadTreeInput(input)
    all_data.append(data)
    types.append(d_type)
doc_dict.update({"elements_data":dicts})
all_data_tree = th.list_to_tree(all_data) 
print "output file is" , file_name

if write_json:
    out_string = json.dumps(doc_dict,ensure_ascii=False)
    with open(file_name, 'wb') as f:
        f.write(out_string.encode('utf-8'))
# ---------- end ghpython_script ----------

# ---- group: relations
panel_8 = Panel("{20;*}")
panel_9 = Panel("{22;*}")
panel_10 = Panel("{21;*}")

# ----
# EXCEL WRITER
# 1
# 2
# 3
# 4
# 5
item_amount = Panel("6")

# ----
# DOCUMENT DATA
series = Series(Start=0, Step=1, Count=item_amount)
split_list = SplitList(List=ghpython_script.names, Index=item_amount)  # -> ListA, ListB
data_path = DataPath(series)
split_tree = SplitTree(Data=ghpython_script.all_data_tree, Masks=flatten(data_path))  # -> Positive, Negative
excel_write = ExcelWrite(
    WriteExcelData=Button(),
    WorkbookPath=text_join,
    WorksheetName="document_data",
    ColumnHeadings=split_list.ListA,
    Data=simplify(split_tree.Positive),
    ClearSheet=True)

# ----
# ELEMENT DATA
merge_4 = Merge(Data1=panel_8, Data2=panel_10, Data3=panel_9)  # -> simplify(Result)
list_length_3 = ListLength(List=split_list.ListB)
list_length_4 = ListLength(List=merge_4)
subtraction = Subtraction(A=list_length_3, B=list_length_4)
series_2 = Series(Start=item_amount, Step=1, Count=subtraction)
data_path_2 = DataPath(series_2)
split_tree_2 = SplitTree(Data=ghpython_script.all_data_tree, Masks=flatten(data_path_2))  # -> Positive, Negative
split_list_2 = SplitList(List=split_list.ListB, Index=subtraction)  # -> ListA, ListB
replace_nulls_3 = ReplaceNulls(Items=split_tree_2.Positive, Replacements="-")  # -> Items, Count
excel_write_2 = ExcelWrite(
    WriteExcelData=Button(),
    WorkbookPath=text_join,
    WorksheetName="element_data",
    ColumnHeadings=split_list_2.ListA,
    Data=simplify(replace_nulls_3.Items),
    ClearSheet=True)

# ----
# CONTAINS
split_tree_3 = SplitTree(Data=ghpython_script.all_data_tree, Masks=flatten(panel_10))  # -> simplify(Positive), Negative
flip_matrix = FlipMatrix(Data=split_tree_3.Positive)
replace_nulls_4 = ReplaceNulls(Items=flip_matrix, Replacements="-")  # -> Items, Count
flip_matrix_2 = FlipMatrix(Data=replace_nulls_4.Items)
excel_write_3 = ExcelWrite(
    WriteExcelData=Button(),
    WorkbookPath=text_join,
    WorksheetName="contains",
    ColumnHeadings=element_passport_2.UniqueID,
    Data=simplify(flip_matrix_2),
    ClearSheet=True)

# ----
# CONTAINED IN
split_tree_4 = SplitTree(Data=ghpython_script.all_data_tree, Masks=flatten(panel_9))  # -> simplify(Positive), Negative
flip_matrix_3 = FlipMatrix(Data=split_tree_4.Positive)
replace_nulls_5 = ReplaceNulls(Items=flip_matrix_3, Replacements="-")  # -> Items, Count
flip_matrix_4 = FlipMatrix(Data=replace_nulls_5.Items)
excel_write_4 = ExcelWrite(
    WriteExcelData=Button(),
    WorkbookPath=text_join,
    WorksheetName="contained_in",
    ColumnHeadings=element_passport_2.UniqueID,
    Data=simplify(flip_matrix_4),
    ClearSheet=True)

# ----
# INTERSECTS
split_tree_5 = SplitTree(Data=ghpython_script.all_data_tree, Masks=flatten(panel_8))  # -> simplify(Positive), Negative
flip_matrix_5 = FlipMatrix(Data=split_tree_5.Positive)
replace_nulls_6 = ReplaceNulls(Items=flip_matrix_5, Replacements="-")  # -> Items, Count
flip_matrix_6 = FlipMatrix(Data=replace_nulls_6.Items)
excel_write_5 = ExcelWrite(
    WriteExcelData=Button(),
    WorkbookPath=text_join,
    WorksheetName="intersects",
    ColumnHeadings=element_passport_2.UniqueID,
    Data=simplify(flip_matrix_6),
    ClearSheet=True)

panel_11 = Panel(excel_write)
panel_12 = Panel(excel_write_4)
panel_13 = Panel(excel_write_2)
panel_14 = Panel(excel_write_3)
panel_15 = Panel(excel_write_5)
